# Grasshopper definition Kohonen_map_csv.gh (Grasshopper 1.0.7)
# plug-ins: KohonenMapper, TT Toolbox, Tree8, Bifocals

panel = Panel("C:\Users\INTEL\Desktop\aia\data\data40_som.xlsx")
panel_2 = Panel("finalmlmlml_som.xlsx")
panel_3 = Panel("""4160
4196
4175
338
334
350""")  # disabled
panel_4 = Panel("""1
2""")  # disabled
file_path = FilePath("C:\Users\INTEL\Desktop\aia\data\data80_som.xlsx")
file_path_2 = FilePath("C:\Users\INTEL\Desktop\aia\data\finalmlmlml_som.xlsx")
file_path_3 = FilePath("C:\Users\INTEL\Desktop\maps\fictionst_gh_without_lables.xlsx")
number_slider = Slider(5, range=0..100)
number_slider_2 = Slider(0, range=0..100)
read_excel_sheet = ReadExcelSheet(Run=Toggle(True), FilePath=file_path_2, Worksheet="1", Listen=False)  # -> UserMessages, Columns, Rows
panel_5 = Panel(read_excel_sheet.Rows)
tree_statistics = TreeStatistics(Tree=read_excel_sheet.Rows)  # -> Paths, Length, Count
series = Series(Start=Slider(1, range=0..100), Step=1, Count=tree_statistics.Count)  # -> simplify(Series)
tree_statistics_2 = TreeStatistics(Tree=read_excel_sheet.Columns)  # -> Paths, Length, Count
list_length = ListLength(List=tree_statistics.Length)
panel_6 = Panel(tree_statistics.Length)
tree_branch = TreeBranch(Tree=read_excel_sheet.Rows, Path=series, MaintainPaths=True, SplitTree=False)

number_slider_3 = Slider(13, range=0..30)
series_2 = Series(Start=Slider(1, range=0..1), Step=1, Count=tree_statistics_2.Count)
tree_branch_2 = TreeBranch(Tree=read_excel_sheet.Columns, Path=series_2, MaintainPaths=True, SplitTree=False)
bounds = Bounds(Numbers=tree_branch_2)  # -> flatten(Domain)
construct_domain = ConstructDomain(DomainStart=Slider(0, range=0..100), DomainEnd=Slider(1, range=0..1))
remap_numbers = RemapNumbers(Value=tree_branch, Source=bounds, Target=construct_domain)  # -> Mapped, Clipped

list_item = ListItem(List=tree_statistics.Length, Index=0, Wrap=True)
multiplication = Multiplication(A=list_length, B=list_item)
panel_7 = Panel(series)
panel_8 = Panel(tree_branch)
panel_9 = Panel(remap_numbers.Mapped)

number_slider_4 = Slider(0.996, range=0..1)  # disabled
number_slider_5 = Slider(42, range=0..100)  # disabled
number_slider_6 = Slider(0.999, range=0..1)  # disabled
neigh = Slider(0.5, range=0..1)  # disabled
panel_10 = Panel("0.95")  # disabled
panel_11 = Panel("0.98")  # disabled

# ---- group: The original seed
panel_12 = Panel("6")  # disabled

# ---- group: 1. Toggle to False
toggle = BooleanToggle(False)

# ---- group: 2. Enable timer
timer = Timer(Interval=20, TimerInterval=20, Target=kohonen_map)  # disabled

# ----
kohonen_map = KohonenMap(
    Reset=toggle,
    XMap=Slider(80, range=0..200),
    YMap=Slider(80, range=0..200),
    Space=Slider(2, range=0..10),
    Inputs=remap_numbers.Mapped,
    WinLearn="0.95",
    Learn="0.9",
    WinLearnDecay="0.999",
    LearnDecay="0.998",
    NeighDecay=0.99,
    NeighRad=Slider(0.6, range=0..1),
    Seed=Slider(42, range=0..42))  # -> Coverged, Counter, Locations, Synaptics, Neigh, InputLocations

# ---- group: removing the normalization
number_slider_7 = Slider(11, range=0..100)
series_3 = Series(Start=Slider(1, range=0..1), Step=1, Count=tree_statistics_2.Count)
tree_branch_3 = TreeBranch(Tree=read_excel_sheet.Columns, Path=series_3, MaintainPaths=True, SplitTree=False)
bounds_2 = Bounds(Numbers=tree_branch_3)  # -> flatten(Domain)
construct_domain_2 = ConstructDomain(DomainStart=Slider(0, range=0..100), DomainEnd=Slider(1, range=0..1))
dataset = Data(Tree({0;0}: [0.478193789, 0.1690869654, 0.4426405205, 0.7834327094, 0.04609928877, 0.5619973407, 0.7820016114, 0.612439895, 0.590334807, 0.5110864648, 0.7615492419, 0.4457187184, 0.4190670735, 0.6572561623], {0;1}: [0.3116469474, 0.1056539205, 0.6705098005, 0.4865986262, 0.2770798554, 0.4964278769, 0.5106930947, 0.5814423157, 0.6522166889, 0.8170421723, 0.8109778596, 0.770063675, 0.6859817919, 0.8262821304], {0;2}: [0.2142473056, 0.2282865156, 0.7484183395, 0.7525169126, 0.03406184555, 0.5108337866, 0.6321383541, 0.7657984688, 0.7914652443, 0.8273240068, 0.736944883, 0.5287766125, 0.4810096455, 0.6047767274], {0;3}: [0.269707784, 0.150622746, 0.7550983969, 0.6152611761, 0.005926652251, 0.6670245805, 0.6467697441, 0.6506637092, 0.7810638136, 0.7940098079, 0.5573845548, 0.7896497302, 0.6670217002, 0.6697636231], {0;4}: [0.2193789578, 0.1180385109, 0.5138705638, 0.5477380751, 0.1780159824, 0.7790557983, 0.6626681813, 0.6688231632, 0.633408998, 0.8456511509, 0.8105030565, 0.804465373, 0.550044927, 0.708246751], {0;5}: [0.3512815395, 0.2299607393, 0.6493295927, 0.641316343, 0.01231959763, 0.7590620092, 0.6143882014, 0.7430938046, 0.8180728836, 0.7411297837, 0.7757788426, 0.6041652487, 0.6619443871, 0.7378411668]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))
data = Data(kohonen_map.Synaptics)
remap_numbers_2 = RemapNumbers(Value=data, Source=construct_domain_2, Target=bounds_2)  # -> Mapped, Clipped

# ----
panel_13 = Panel(kohonen_map.Coverged)

# ---- group: Display map
item = ListItem(List=kohonen_map.Synaptics, Index=0, Wrap=True)  # -> Item, Item1, Item2
frgb = ColourRGBF(Alpha=1, Red=item.Item, Green=item.Item1, Blue=item.Item2)
box = CenterBox(Base=kohonen_map.Locations, X=1, Y=1, Z=1)
preview = CustomPreview(Geometry=box, Shader=frgb)

# ----
number_slider_8 = Slider(0.5, range=0..1)
panel_14 = Panel(remap_numbers_2.Mapped)
line = LineSDL(Start=kohonen_map.InputLocations, Direction=Vector(0, 0, 1), Length=Slider(9, range=0..100))

number_slider_9 = Slider(0, range=0..100)  # disabled
panel_15 = Panel("60")  # disabled
series_4 = Series(Start=number_slider_9, Step=1, Count=panel_15)  # -> simplify(graft(Series)); disabled
series_5 = Series(Start=number_slider_9, Step=1, Count=panel_15)  # -> simplify(Series); disabled
number_slider_10 = Slider(14, range=0..100)  # disabled
panel_16 = Panel(",")  # disabled
number_slider_11 = Slider(0, range=0..1)  # disabled
concatenate = Concatenate(Fragment_A=series_4, A=panel_16)  # disabled
series_6 = Series(Start=number_slider_11, Step=1, Count=number_slider_10)  # disabled
concatenate_2 = Concatenate(Fragment_A=concatenate, A=series_5)  # -> flatten(Result); disabled
tree_item = TreeItem(Tree=simplify(remap_numbers_2.Mapped), Path=concatenate_2, Index=graft(series_6), Wrap=True)  # -> simplify(Element); disabled

# ---- group: Feature dimension (=3)
number_slider_12 = Slider(3, range=0..10)  # disabled

# ---- group: Number of inputs (could be real data rather than random)
number_slider_13 = Slider(4, range=0..10)  # disabled

# ----
multiplication_2 = Multiplication(A=number_slider_13, B=number_slider_12)  # disabled
panel_17 = Panel("342")  # disabled
random = Random(Range=Domain(0, 1), Number=multiplication_2, Seed=panel_17)  # disabled

# ---- group: Weaves data into tree
c_script = CSharpScript(x=random, y=number_slider_12)  # -> A; inputs x: list of Double, y: Int32; disabled
# ---------- c_script: C# ----------
    var tree = new DataTree<double>();
    GH_Path path;
    int legge = x.Count / y;
    int counter = 0;
    
    for (int i = 0; i < legge; i++)
    {
      path = new GH_Path(i);
      for (int j = 0; j < y; j++)
      {
        tree.Add(x[counter], path);
        counter++;
      }
    }

    A = tree;
# ---------- end c_script ----------

# ----
panel_18 = Panel(random)  # disabled
labels = Panel("3000")
panel_19 = Panel(c_script)  # disabled

# ---- group: writer / compile dataset
panel_20 = Panel("C:\Users\INTEL\Desktop\New folder\")

# ---- group: writer
labels_2 = Panel("""UHI
	amenities_index	
buildings_index	
tree_index
	benches_index	
fountain_index
	art_pts_index
	parking_index
	highway_cat	
vegetation_index
	water_index
	parking_index
	SCORE""")
num = Number(labels)
join = TextJoin(Text=tree_item, Join=" ")  # disabled
join_2 = TextJoin(Text=labels_2, Join=" ")
num_2 = Number(num)
export_robotmotion_3_r3_multi = PythonScript(toggle=Toggle(True), path=panel_20, x=join, labs=join_2, y=num_2)
# ---------- export_robotmotion_3_r3_multi: Python ----------
#script by Gabriella Rossi / CITA
import os
from os import listdir
from os.path import isfile, join
from scriptcontext import sticky as st

if True:
    #Create file
    filename = str(path)
    fil = open(filename, 'a+')
    
    if y < 1 :

        #write header and first line
        fil.write(labs)
        fil.write('\n' + x)
    else:
        #just write line
        fil.write('\n' + x)

    fil.close()
# ---------- end export_robotmotion_3_r3_multi ----------

# ----
write_options = WriteOptions(
    FilePath=panel_20,
    ClearDataOverwrite=True,
    SaveAfterWrite=Toggle(True),
    CloseAfterWrite=False,
    ColumnStartPosition=1,
    RowStartPosition=1)  # -> UserMessages, WriteOptions

write_to_excel = WriteToExcel(
    Run=Toggle(False),
    ExcelWorksheet="1",
    ColumnNames=labels_2,
    WriteOptions=write_options.WriteOptions,
    ColumnnsOrRows=Toggle(True),
    DataToWriteIntoColumns=remap_numbers_2.Mapped)

# ---- group: Display input location on map
item_2 = ListItem(List=remap_numbers.Mapped, Index=0, Wrap=True)  # -> Item, Item1, Item2
box_2 = CenterBox(Base=graft(kohonen_map.InputLocations), X=number_slider_8, Y=number_slider_8, Z=number_slider_8)
frgb_2 = ColourRGBF(Alpha=1, Red=item_2.Item, Green=item_2.Item1, Blue=item_2.Item2)

# ----
move = Move(Geometry=box_2, Motion=Vector(0, 0, 10))  # -> Geometry, Transform

# ---- group: Display input location on map (continued)
preview_2 = CustomPreview(Geometry=move.Geometry, Shader=frgb_2)
